# Grasshopper definition project_designs.gh (Grasshopper 1.0.8)

series = Series(Start=0, Step=1, Count=Slider(490, range=0..1000))
series_2 = Series(Start=0, Step=1, Count=Slider(490, range=0..1000))
image_sampler = ImageSampler(
    FilePath="/Users/a.../Desktop/Masters/Fall24/CSCI7000_ComFab/CSCI-7000-Computational-Fabrication/imgs/proj_laceDesign.jpg",
    Filter="Colour",
    Interpolate=False,
    Umax=1,
    Umin=0,
    Vmax=1,
    Vmin=0,
    Wrap=1)
